# Grasshopper definition BVN Office Layout.gh (Grasshopper 0.9.76)
# plug-ins: Python Interpreter, LunchBox

srf = Surface(<surface referenced from the Rhino model>)
grid = GridStructure(Surface=srf, UDivisions=Slider(10, range=0..10), VDivisions=Slider(10, range=0..10))  # -> StructureLines, StructureNodes

# ---- group: 01. Isovist Model (with Basestation Points)
geometry_pipeline = GeometryPipeline(
    GroupByLayer=False,
    GroupByType=False,
    IncludeHidden=True,
    IncludeLocked=True,
    LayerFilter="beacon_locations",
    NameFilter="*",
    TypeFilter=1)
pipeline = GeometryPipeline(
    GroupByLayer=False,
    GroupByType=False,
    IncludeHidden=True,
    IncludeLocked=True,
    LayerFilter="bvn_officespace_boundary",
    NameFilter="*",
    TypeFilter=4)
point = Point(geometry_pipeline)
data_dam = DataDam(DataDataA=point, BufferDelay=10000000, BufferMode=0)
python = PythonScript(points=data_dam, lines=Slider(1000, range=0..1000), radius=Slider(6000, range=0..10000), boundries=pipeline)  # -> pointOut, totalIsovist, isovistsClear, overlapSpace, isovistsList, isovistTotalSurface, nonOverlapSpace; inputs points: list of Point3d, lines: Int32, radius: Int32, boundries: list
# ---------- python: Python ----------
import ghpythonlib.components as ghcomp
import rhinoscriptsyntax as rs
import Rhino.Geometry as rg




isovistsList = []
overlapSpaceList = []
isovistsClear = []
pointOut = points

for point in points:
    isovists = ghcomp.IsoVist(point,lines,radius,boundries)
    getIsovistPoints=isovists[0]
    isovistsOutline = ghcomp.PolyLine(getIsovistPoints,True)
    makeSurface = ghcomp.BoundarySurfaces(isovistsOutline)
    print makeSurface
    isovistsList.append(makeSurface)

coerceBrepList = []

for individualIsovists in isovistsList:
    coercedOneBrep = rs.coercebrep(individualIsovists)
    coerceBrepList.append(coercedOneBrep)

isovistCoercedUnion = ghcomp.RegionUnion(coerceBrepList)
isovistTotalSurface = ghcomp.BoundarySurfaces(isovistCoercedUnion)

interA = isovistsList[0:len(isovistsList)-1]
interB = isovistsList[1:]

for itsA in interA:
    for itsB in interB:
        if itsA == itsB:
            print itsA
        else:
            regionInter = ghcomp.RegionIntersection(itsA,itsB)
            surfaceInter = ghcomp.BoundarySurfaces(regionInter)
            #if len(surfaceInter) != 1:
            #    for listList in surfaceInter:
            #        print listList
            #        overlapSpaceList.append(listList)
            overlapSpaceList.append(surfaceInter)


flatOver = []

for testList in overlapSpaceList:
    testIfList = isinstance(testList, list)
    if testIfList == True:
        for isList in testList:
            flatOver.append(isList)
    else:
        flatOver.append(testList)

overlapSpace = flatOver

##asd = []

##overlapSpace = ghcomp.RegionUnion(flatOver)

##for getnotOverlapSpace in isovistsList:
##    pineapple = ghcomp.RegionDifference(getnotOverlapSpace, overlapSpace)
##    asd.append(pineapple)
##nonOverlapSpace = asd


#overlapCombination = ghcomp.RegionUnion(flatOver)
#print overlapCombination
#overlapSurface = ghcomp.BoundarySurfaces(overlapCombination)
#overlapCalcArea = ghcomp.Area(overlapSurface)
#print overlapCalcArea


#for overlapPiece in overlapCalcArea[0]:
#    overlapArea = overlapArea + overlapPiece

#print overlapSpaceList
#overlapSpace = flatOver



#ghcomp.regi

#a = isovistsList
# ---------- end python ----------
curve = Curve(python.isovistsList)

# ----
cp = ClosestPoint()  # -> ClosestPoint, CPIndex, Distance
cps = ClosestPoints(Count=3)  # -> ClosestPoint, CPIndex, Distance
brepinc = PointInBrep(Strict=False)
srf_2 = Surface(python.isovistTotalSurface)
incurves = PointInCurves()  # -> Relationship, Index, Point
curve_2 = Curve(python.isovistsList)
grid_2 = GridStructure(Surface=srf_2, UDivisions=Slider(20, range=0..20), VDivisions=Slider(20, range=0..20))  # -> StructureLines, StructureNodes
srf_3 = Surface(python.isovistTotalSurface)
item = ListItem(List=curve_2, Index=Slider(0, range=0..10), Wrap=True)

# ---- group: Bake
colour_swatch = ColourSwatch(SwatchColor=RGB(0, 255, 255))
object_bake = ObjectBake(
    BakeToggle=Toggle(True),
    GeometryObjects=curve,
    Layer="_gh_circle_isovist_BVN",
    ObjectName="GH_Obj",
    ObjectColor=colour_swatch,
    LayerColor=colour_swatch)

# ----
incurve = PointInCurve(Point=grid_2.StructureNodes, Curve=srf_3)  # -> Relationship, Point
incurve_2 = PointInCurve(Point=grid_2.StructureNodes, Curve=item)  # -> Relationship, Point
bool = Boolean(incurve_2.Relationship)
incurves_2 = PointInCurves()  # -> Relationship, Index, Point
brepinc_2 = PointInBrep(Strict=False)
dispatch = Dispatch(List=incurve_2.Point, DispatchPattern=bool)  # -> ListA, ListB

# ---- group: Outside
pt = Point(dispatch.ListB)

# ---- group: Coincident/Inside
pt_2 = Point(dispatch.ListA)

# ----
dots = DotDisplay(Point=pt_2, Colour=RGB(0, 0, 0), Size=1)
dots_2 = DotDisplay(Point=pt, Colour=RGB(0, 0, 0), Size=1)
